# Grasshopper definition Branch Dish redesigned.gh (Grasshopper 1.0.7)
# plug-ins: Pufferfish, Anemone

# ---- group: start up and inner circle / actual diameter of outermost circle
number_slider = Slider(3300, range=0..3300)

# ----
pt = Point(Point(0, 0, 0))
pt_2 = Point(Point(0, 0, 0))
pt_3 = Point(Point(-88.86925505, 59.64162212, 0))
pt_4 = Point(Point(0, 0, 1690.872395))
pt_5 = Point(Point(0, 214.0574247, 0))
pl_3pt = Plane3Pt(PointA=pt_2, PointB=pt_3, PointC=pt_4)
rad = Radians(Degrees=Slider(180, range=0..360))
rad_2 = Radians(Degrees=Slider(47, range=0..360))
rotate = Rotate(Geometry=pt_5, Angle=rad, Plane=pl_3pt)  # -> Geometry, Transform
rotate_2 = Rotate(Geometry=pl_3pt, Angle=rad_2, Plane=PlaneXY(0, 0, 0))  # -> Geometry, Transform
vec2pt = Vector2Pt(PointA=pt, PointB=rotate.Geometry, Unitize=False)  # -> Vector, Length
Y = UnitY(Factor=Slider(1, range=0..1))
vec = VectorXYZ(XComponent=0, YComponent=Y, ZComponent=0)  # -> Vector, Length
angle = Angle(VectorA=vec.Vector, VectorB=vec2pt.Vector)  # -> Angle, Reflex

# ---- group: start up and inner circle
pt_6 = ConstructPoint(XCoordinate=0, YCoordinate=0, ZCoordinate=0)
number_slider_2 = Slider(2, range=0..10)
number_slider_3 = Slider(1, range=0..10)
rad_3 = Radians(Degrees=Slider(210, range=0..360))
division = Division(A=number_slider, B=number_slider_2)

# ---- group: start up and inner circle / rotate inner points
rad_4 = Radians(Degrees=Slider(0, range=0..360))

# ---- group: moving arcs
rad_5 = Radians(Degrees=Slider(30, range=0..100))
number_slider_4 = Slider(1, range=0..1)

# ---- group: chang arc length per iteration
rad_6 = Radians(Degrees=Slider(19, range=0..360))
rad_7 = Radians(Degrees=Slider(360, range=0..360))

# ---- group: loop system
number_slider_5 = Slider(15, range=0..30)

# ---- group: start up and inner circle (continued)
addition = Addition(A=number_slider_5, B=number_slider_2)
division_2 = Division(A=division, B=addition)
arc = Arc(Plane=pt_6, Radius=division_2, Angle=rad_3)  # -> Arc, Length
divide = DivideCurve(Curve=arc.Arc, Count=number_slider_3, Kinks=False)  # -> Points, Tangents, Parameters
popgeo = PopulateGeometry(Geometry=arc.Arc, Count=number_slider_3, Seed=1)

# ---- group: start up and inner circle / rotate inner points (continued)
rotate_3 = Rotate(Geometry=divide.Points, Angle=rad_4, Plane=PlaneXY(0, 0, 0))  # -> Geometry, Transform

# ---- group: start up and inner circle (continued)
ln = Line(StartPoint=pt_6, EndPoint=rotate_3.Geometry)

# ---- group: loop system (continued)
fastloopstart = FastLoopStart(I=number_slider_5, D0=division_2, D1=ln, D2=rad_3)  # -> port, Counter, Data, Data_2, Data_3
end = EndPoints(Curve=fastloopstart.Data_2)  # -> Start, End
pt_7 = Point(end.End)
lng = ListLength(List=pt_7)
random = Random(Range=Domain(0, 1), Number=lng, Seed=2)
smaller = SmallerThan(FirstNumber=random, SecondNumber=Slider(0.3, range=0..1))  # -> SmallerThan, OrEqualTo
addition_2 = Addition(A=smaller.SmallerThan, B=1)  # -> graft(Result)
graft = GraftTree(Tree=pt_7, IncludeEmptyLists=True, IncludeNullItems=True)
dup = DuplicateData(Data=graft, Number=addition_2, Order=True)  # -> simplify(Data)
flatten = FlattenTree(Tree=dup, Path="{0}")
lng_2 = ListLength(List=flatten)

# ---- group: chang arc length per iteration (continued)
pow = Power(A=fastloopstart.Data_3, B=Slider(1.3, range=0..2))
addition_3 = Addition(A=fastloopstart.Data_3, B=rad_6)
multiplication = Multiplication(A=fastloopstart.Data_3, B=Slider(1.037, range=1..1.1))
min = Minimum(A=addition_3, B=rad_7)
min_2 = Minimum(A=pow, B=rad_7)

# ---- group: change radius per iteration
addition_4 = Addition(A=fastloopstart.Data, B=division_2)

# ---- group: moving arcs (continued)
remap = RemapNumbers(Value=addition_4, Source=division_2, Target=rad_5)  # -> Mapped, Clipped
sin = Sine(Value=remap.Mapped)
midpt = CurveMiddle(Curve=arc.Arc)
multiplication_2 = Multiplication(A=sin, B=Slider(50, range=0..100))
vec2pt_2 = Vector2Pt(PointA=midpt, PointB=pt_6, Unitize=False)  # -> Vector, Length
arc_2 = Arc(Plane=pt_6, Radius=addition_4, Angle=min)  # -> Arc, Length
midpt_2 = CurveMiddle(Curve=arc_2.Arc)
vec2pt_3 = Vector2Pt(PointA=midpt_2, PointB=pt_6, Unitize=False)  # -> Vector, Length
amp = Amplitude(Vector=vec2pt_3.Vector, Amplitude=number_slider_4)
amp_2 = Amplitude(Vector=vec2pt_2.Vector, Amplitude=number_slider_4)
Z = UnitZ(Factor=multiplication_2)
orient = OrientDirection(Geometry=arc_2.Arc, PointA=pt_6, DirectionA=amp, PointB=pt_6, DirectionB=amp_2)  # -> Geometry, Transform
move = Move(Geometry=orient.Geometry, Motion=Z)  # -> Geometry, Transform

# ----
cir = Circle(Plane=pt_6, Radius=addition_4)

# ---- group: loop system (continued)
midpt_3 = CurveMiddle(Curve=move.Geometry)  # disabled
end_2 = EndPoints(Curve=move.Geometry)  # -> Start, End
popgeo_2 = PopulateGeometry(Geometry=move.Geometry, Count=lng_2, Seed=Slider(1, range=0..100))
pt_8 = Point([end_2.End, end_2.Start, midpt_3])
cp = ClosestPoint(Point=[popgeo_2, pt_8], Cloud=flatten)  # -> ClosestPoint, CPIndex, Distance
flatten_2 = FlattenTree(Tree=cp.ClosestPoint, Path="{0}")
flatten_3 = FlattenTree(Tree=[pt_8, popgeo_2], Path="{0}")
ln_2 = Line(StartPoint=flatten_2, EndPoint=flatten_3)
fastloopend = FastLoopEnd(port=fastloopstart.port, Exit=False, Data=addition_4, Data_2=ln_2, Data_3=addition_3, RecordData=True, TimeOutVal=0)  # -> D0, simplify(D1), simplify(D2)

# ---- group: loft & offset
Z_2 = UnitZ(Factor=Slider(160, range=0..1000))
merge = Merge(Data1=ln, Data2=fastloopend.D1)
xy = XYPlane(Origin=Point(0, 0, 0))
move_2 = Move(Geometry=merge, Motion=Z_2)  # -> Geometry, Transform
project = Project(Geometry=move_2.Geometry, Plane=xy)  # -> Geometry, Transform
graft_2 = GraftTree(Tree=move_2.Geometry, IncludeEmptyLists=True, IncludeNullItems=True)
graft_3 = GraftTree(Tree=project.Geometry, IncludeEmptyLists=True, IncludeNullItems=True)
merge_2 = Merge(Data1=graft_2, Data2=graft_3)
loft = Loft(Curves=merge_2, Options={Adjust=False, Closed=False, LoftEnds=0, LoftSimp=0, LoftType=0, Rebuild=10, Refit=0.01})
offmsh = OffsetMesh(Mesh=loft, Distance=Slider(5, range=0..100), BothSides=Toggle(True), CreateSolid=True)

# ---- group: outer wall
flatten_4 = FlattenTree(Tree=fastloopend.D0, Path="{0}")
arc_3 = Arc(Plane=PlaneXY(0, 0, 0), Radius=flatten_4, Angle=rad_7)  # -> Arc, Length
midpt_4 = CurveMiddle(Curve=arc_3.Arc)
midpt_5 = CurveMiddle(Curve=arc.Arc)
vec2pt_4 = Vector2Pt(PointA=midpt_4, PointB=pt_6, Unitize=False)  # -> Vector, Length
vec2pt_5 = Vector2Pt(PointA=midpt_5, PointB=pt_6, Unitize=False)  # -> Vector, Length
amp_3 = Amplitude(Vector=vec2pt_4.Vector, Amplitude=number_slider_4)
amp_4 = Amplitude(Vector=vec2pt_5.Vector, Amplitude=number_slider_4)
flatten_5 = FlattenTree(Tree=move_2.Geometry, Path="{0}")
listdexs = ListIndices(List=flatten_5)
bnd = Bounds(Numbers=listdexs)
orient_2 = OrientDirection(Geometry=arc_3.Arc, PointA=pt_6, DirectionA=amp_3, PointB=pt_6, DirectionB=amp_4)  # -> Geometry, Transform
item = ListItem(List=flatten_5, Index=bnd, Wrap=True)
end_3 = EndPoints(Curve=item)  # -> Start, End
xy_2 = XYPlane(Origin=Point(0, 0, 0))
item_2 = ListItem(List=orient_2.Geometry, Index=number_slider_5, Wrap=True)
project_2 = Project(Geometry=end_3.End, Plane=xy_2)  # -> Geometry, Transform
offset = OffsetCurve(Curve=item_2, Distance=Slider(5, range=0..100), Plane=PlaneXY(0, 0, 0), Corners=1)
dist = Distance(PointA=project_2.Geometry, PointB=end_3.End)
end_4 = EndPoints(Curve=offset)  # -> Start, End
end_5 = EndPoints(Curve=item_2)  # -> Start, End
Z_3 = UnitZ(Factor=dist)
ln_3 = Line(StartPoint=end_4.Start, EndPoint=end_5.Start)
ln_4 = Line(StartPoint=end_4.End, EndPoint=end_5.End)
join = JoinCurves(Curves=[ln_3, offset, item_2, ln_4], Preserve=False)
extr = Extrude(Base=join, Direction=Z_3)

# ----
panel = Panel(fastloopend.D0)

# ---- group: optional display
smesh = SimpleMesh(Brep=loft)
flatten_6 = FlattenTree(Tree=smesh, Path="{0}")
mjoin = MeshJoin(Meshes=flatten_6)
demesh = DeconstructMesh(Mesh=mjoin)  # -> Vertices, Faces, Colours, Normals
pt_9 = Point(pt_6)
dist_2 = Distance(PointA=pt_9, PointB=demesh.Vertices)
bnd_2 = Bounds(Numbers=flatten(dist_2))
remap_2 = RemapNumbers(Value=dist_2, Source=bnd_2, Target=Domain(0, 1))  # -> Mapped, Clipped
gradient = Gradient(
    LowerLimit=0,
    UpperLimit=1,
    Parameter=remap_2.Mapped,
    stops=[0: RGB(56, 0, 240), 0.498: RGB(194, 228, 255), 1: RGB(147, 124, 252)])
mcol = MeshColours(Mesh=mjoin, Colours=gradient)

# ----
demesh_2 = DeconstructMesh(Mesh=offmsh)  # -> Vertices, Faces, Colours, Normals
deface = DeconstructFace(Face=demesh_2.Faces)  # -> CornerA, CornerB, CornerC, CornerD
item_3 = ListItem(List=demesh_2.Vertices, Index=deface.CornerB, Wrap=True)
item_4 = ListItem(List=demesh_2.Vertices, Index=deface.CornerC, Wrap=True)
item_5 = ListItem(List=demesh_2.Vertices, Index=deface.CornerD, Wrap=True)
item_6 = ListItem(List=demesh_2.Vertices, Index=deface.CornerA, Wrap=True)
srf4pt = _4PointSurface(CornerA=item_6, CornerB=item_3, CornerC=item_4, CornerD=item_5)
fmerge = MergeFaces(Brep=srf4pt)  # -> Breps, Before, After
join_2 = BrepJoin(Breps=srf4pt)  # -> Breps, Closed
item_7 = ListItem(List=fmerge.Breps, Index=Slider(1, range=0..10000), Wrap=True)
item_8 = ListItem(List=fmerge.Breps, Index=Slider(3154, range=0..5030), Wrap=True)
edgesdir = EdgesFromDirections(Brep=srf4pt, Directions=vec2pt.Vector, Reflex=True, Angle=angle.Angle)  # -> Edges, Indices, Map; disabled
